# Dynamo custom node Deconstruct Location.dyf (Dynamo 0.9.1.3872)
# category: Ladybug.0|Ladybug
# Get different location data from a location string

# group: load the script
code_block = CodeBlock { "deconstructLocation_node.py"; }

find_file_and_import_it = Python(IN[0]=code_block)
# ---------- find_file_and_import_it.python (21 lines) ----------
try:
	def getPackagePath(packageName):
		import sys
		sys.path.append('C:\Program Files (x86)\IronPython 2.7\Lib')
		import os
		import clr
		clr.AddReference('DynamoCore')
		dynamoPath = clr.References[2].Location.split('\\')[2].replace(' ', '\\')
		appdata = os.getenv('APPDATA')
		return '%s\%s\packages\%s\extra\\'%(appdata, dynamoPath, packageName)
	
	filePath = getPackagePath('Ladybug') + IN[0]
	
	with open(filePath, 'rb') as inf:
	    lines = inf.readlines()
	
	OUT = ''.join(lines)
except Exception, e:
	OUT = "ERROR: %s"%str(e) + \
		"\n\nIf you think this is a bug submit an issue on github.\n" + \
		"https://github.com/ladybug-analysis-tools/ladybug-dynamo/issues"
# ----------------------------------------
location = Input(_location: System.Object)  # The output from the importLocation, importEPW or constructLocation component.  This is essentially a list of text summarizing a location on the earth.
python_script_from_string = PythonStringNode(script=find_file_and_import_it, IN[0]=location)
code_block_2 = CodeBlock(out=python_script_from_string) { out[0]; out[1]; out[2]; out[3]; out[4]; }
locationName = Output(code_block_2.out0)
latitude = Output(code_block_2.out1)
longitude = Output(code_block_2.out2)
timeZone = Output(code_block_2.out3)
elevation = Output(code_block_2.out4)
error_report = Python(IN[0]=find_file_and_import_it, IN[1]=python_script_from_string)
# ---------- error_report.python (15 lines) ----------
"""Report errors"""
importErr = IN[0]
runErr = IN[1]
errors = []

if importErr and str(importErr).startswith("ERROR:"):
	errors.append(importErr)

if runErr and str(runErr).startswith("ERROR:"):
	errors.append(runErr)

if len(errors)==0:
	OUT = "All good! Vvizzzz."
else:
	OUT = "\n".join(errors)
# ----------------------------------------
ERRReport = Output(error_report)
