# Dynamo custom node Filter Sky Matrix.dyf (Dynamo 0.9.1.3872)
# category: Ladybug.2|Visualize Weather Data
# Filter Cumulative Sky for an analysis period. You can also filter diffuse or direct component of the sky

# group: load the script
code_block = CodeBlock { "filterskymtx_node.py"; }
find_file_and_import_it = Python(IN[0]=code_block)
# ---------- find_file_and_import_it.python (16 lines) ----------
def getPackagePath(packageName):
	import sys
	sys.path.append('C:\Program Files (x86)\IronPython 2.7\Lib')
	import os
	import clr
	clr.AddReference('DynamoCore')
	dynamoPath = clr.References[2].Location.split('\\')[2].replace(' ', '\\')
	appdata = os.getenv('APPDATA')
	return '%s\%s\packages\%s\extra\\'%(appdata, dynamoPath, packageName)

filePath = getPackagePath('Ladybug') + IN[0]

with open(filePath, 'rb') as inf:
    lines = inf.readlines()

OUT = ''.join(lines)
# ----------------------------------------

skyMatrix = Input(_skyMatrix: System.Object)  # Sky Matrix. Use Generate Sky Matrix to generate the sky
HOYs = Input(_HOYs_: var[]..[] = 1..8760)  # An analysis period or a list of integers between 1-8760 for hours of the year. Default is All the hours of the year
includeDiffuse = Input(_includeDiffuse_: bool = true)  # Set to False to remove diffuse radiation
includeDirect = Input(_includeDirect_: bool = true)  # Set to False to remove direct radiation
python_script_from_string = PythonStringNode(script=find_file_and_import_it, IN[0]=skyMatrix, IN[1]=HOYs, IN[2]=includeDiffuse, IN[3]=includeDirect)
code_block_2 = CodeBlock(out=python_script_from_string) { out[0]; out[1]; }
filteredSkyMatrix = Output(code_block_2.out0)
skyRadiationValues = Output(code_block_2.out1)
