# Dynamo custom node Generate Sky Matrix.dyf (Dynamo 0.9.1.3872)
# category: Ladybug.2|Visualize Weather Data
# Generate sky matrix for a location from epw file

# group: load the script
code_block = CodeBlock { "genskymtx_node.py"; }
find_file_and_import_it = Python(IN[0]=code_block)
# ---------- find_file_and_import_it.python (16 lines) ----------
def getPackagePath(packageName):
	import sys
	sys.path.append('C:\Program Files (x86)\IronPython 2.7\Lib')
	import os
	import clr
	clr.AddReference('DynamoCore')
	dynamoPath = clr.References[2].Location.split('\\')[2].replace(' ', '\\')
	appdata = os.getenv('APPDATA')
	return '%s\%s\packages\%s\extra\\'%(appdata, dynamoPath, packageName)

filePath = getPackagePath('Ladybug') + IN[0]

with open(filePath, 'rb') as inf:
    lines = inf.readlines()

OUT = ''.join(lines)
# ----------------------------------------

epwFile = Input(_epwFile: string)  # File path to a valid epw file
skyDensity = Input(_skyDensity_: int=0)  # Density of the sky. 0 generates a Tregenza sky, which will divide up the sky dome with a coarse density of 145 sky patches. Set to 1 to generate a Reinhart sky, which will divide up the sky dome using a density of 578 sky patches.
workingDir = Input(workingDir_: string = "")  # A local directory to run the study and write the results If empty files be saved under \Users\#Username\AppData\Roaming\Dynamo\#DynamoVersion\packages\Ladybug\extra\temp\cumulativeSkies\#CityName
# note: gencumulativesky
python_script_from_string = PythonStringNode(script=find_file_and_import_it, IN[0]=epwFile, IN[1]=skyDensity, IN[2]=workingDir)
SkyMatrix = Output(python_script_from_string)
