# Dynamo custom node Import epw.dyf (Dynamo 0.9.1.3360)
# category: Ladybug.0|Ladybug
# Use this node to import lists of weather data into Dynamo from a standard .epw file.
# For detailed information about the structure of an epw file, you may want to read the
# "Weather Converter Program" section in "Auxiliary EnergyPlus Programs" document.
# All descriptions of importaed data are borrowed from this document.
# The document is available online at this address:
# "http://apps1.eere.energy.gov/buildings/energyplus/pdfs/auxiliaryprograms.pdf"

# group: load the script
code_block = CodeBlock { "importEPW.py"; }
find_file_and_import_it = Python(IN[0]=code_block)
# ---------- find_file_and_import_it.python (16 lines) ----------
def getPackagePath(packageName):
	import sys
	sys.path.append('C:\Program Files (x86)\IronPython 2.7\Lib')
	import os
	import clr
	clr.AddReference('DynamoCore')
	dynamoPath = clr.References[2].Location.split('\\')[2].replace(' ', '\\')
	appdata = os.getenv('APPDATA')
	return '%s\%s\packages\%s\extra\\'%(appdata, dynamoPath, packageName)

filePath = getPackagePath('Ladybug') + IN[0]

with open(filePath, 'rb') as inf:
    lines = inf.readlines()

OUT = ''.join(lines)
# ----------------------------------------

epwFile = Input(_epwFile: string)  # File path to a valid epw file
analysisPeriod = Input(_analysisPeriod_: string = "1/1 to 12/31 between 1 to 24 @1")  # Ladybug Analysis Period
python_script_from_string = PythonStringNode(script=find_file_and_import_it, IN[0]=epwFile, IN[1]=analysisPeriod)
separate_outputs = CodeBlock(out=python_script_from_string)
# ---------- separate_outputs.designscript (17 lines) ----------
out[0];
out[1];
out[2];
out[3];
out[4];
out[5];
out[6];
out[7];
out[8];
out[9];
out[10];
out[11];
out[12];
out[13];
out[14];
out[15];
out[16];
# ----------------------------------------
description = Output(separate_outputs.out0)
location = Output(separate_outputs.out1)
dryBulbTemperature = Output(separate_outputs.out2)
dewPointTemperature = Output(separate_outputs.out3)
relativeHumidity = Output(separate_outputs.out4)
windDirection = Output(separate_outputs.out5)
windSpeed = Output(separate_outputs.out6)
directNormalRadiation = Output(separate_outputs.out7)
diffuseHorizontalRadiation = Output(separate_outputs.out8)
globalHorizontalRadiation = Output(separate_outputs.out9)
directNormalIlluminance = Output(separate_outputs.out10)
diffuseHorizontalIlluminance = Output(separate_outputs.out11)
globalHorizontalIlluminance = Output(separate_outputs.out12)
liquidPrecipitationDepth = Output(separate_outputs.out14)
totalSkyCover = Output(separate_outputs.out13)
barometricPressure = Output(separate_outputs.out15)
modelYear = Output(separate_outputs.out16)
