# Dynamo custom node Solar Radiation Analysis.dyf (Dynamo 0.9.1.3872)
# category: Ladybug.3|Environmental Analysis
# Calculate solar radiation for points in wh

# group: load the script
code_block = CodeBlock { "solarRadiation_node.py"; }
find_file_and_import_it = Python(IN[0]=code_block)
# ---------- find_file_and_import_it.python (16 lines) ----------
def getPackagePath(packageName):
	import sys
	sys.path.append('C:\Program Files (x86)\IronPython 2.7\Lib')
	import os
	import clr
	clr.AddReference('DynamoCore')
	dynamoPath = clr.References[2].Location.split('\\')[2].replace(' ', '\\')
	appdata = os.getenv('APPDATA')
	return '%s\%s\packages\%s\extra\\'%(appdata, dynamoPath, packageName)

filePath = getPackagePath('Ladybug') + IN[0]

with open(filePath, 'rb') as inf:
    lines = inf.readlines()

OUT = ''.join(lines)
# ----------------------------------------

testPoints = Input(_testPoints: var[]..[])  # Test points. You can use several methods including using Generate Test Points to generate test points.
pointsNormal = Input(_pointsNormal: var[]..[])  # Points Normal. A vector for each test point should be provided
geometries = Input(_geometries: var[]..[])  # All the context geometries as surfaces
filteredSkyMatrix = Input(_filteredSkyMatrix: System.Object)  # Ladybug Sky. Use Filter Sky Matrix node to generate a filtered sky
python_script_from_string = PythonStringNode(script=find_file_and_import_it, IN[0]=testPoints, IN[1]=pointsNormal, IN[2]=geometries, IN[3]=filteredSkyMatrix)
solarRadiation = Output(python_script_from_string)
