# Dynamo custom node Sunpath.dyf (Dynamo 0.9.1.3360)
# category: Ladybug.2|Visualize Weather Data
# Use this node to make a 3D sun-path (aka. sun plot) in the Dynamo scene.  The node also outputs sun vectors that can be used for sunlight hours analysis or shading design with the other Ladybug nodes.

# group: load the script
code_block = CodeBlock { "sunpath_node.py"; }
find_file_and_import_it = Python(IN[0]=code_block)
# ---------- find_file_and_import_it.python (16 lines) ----------
def getPackagePath(packageName):
	import sys
	sys.path.append('C:\Program Files (x86)\IronPython 2.7\Lib')
	import os
	import clr
	clr.AddReference('DynamoCore')
	dynamoPath = clr.References[2].Location.split('\\')[2].replace(' ', '\\')
	appdata = os.getenv('APPDATA')
	return '%s\%s\packages\%s\extra\\'%(appdata, dynamoPath, packageName)

filePath = getPackagePath('Ladybug') + IN[0]

with open(filePath, 'rb') as inf:
    lines = inf.readlines()

OUT = ''.join(lines)
# ----------------------------------------

north = Input(north_: double = 0)  # Input a number between 0 and 360 that represents the degrees off from the y-axis to make North.  The default North direction is set to the Y-axis (0 degrees).
location = Input(_location: System.Object)  # The output from the importEPW or constructLocation component.  This is essentially a list of text summarizing a location on the earth.
hoursOfYear = Input(_hoursOfYear_: var[]..[] = {12.0})  # A list or a single number that respresent an hour of the year. Use Analysis Period or HOY nodes to generate the number
centerPt = Input(_centerPt_: Autodesk.Geometry.Point = Autodesk.Geometry.Point.Origin())  # Input a point here to change the location of the sun path. The default is set to the Dynamo model origin (0,0,0).
scale = Input(_scale_: double = 1)  # Input a number here to change the scale of the sun path.  The default is set to 1.
sunScale = Input(_sunScale_: double = 1)  # Input a number here to change the scale of the sun spheres located along the sun path.  The default is set to 1.
annualSunpath = Input(_annualSunpath_: bool = true)  # By default, this value is set to "True" (or 1), which will produce a sun path for the whole year.  Set this input to "False" (or 0) to generate a sun path for just one day of the year (or several days if multiple days are included in the analysis period).
daylightSavingPeriod = Input(daylightSavingPeriod_: string = "")  # Daylight saving period as an analysis period
python_script_from_string = PythonStringNode(script=find_file_and_import_it, IN[0]=north, IN[1]=location, IN[2]=hoursOfYear, IN[3]=centerPt, IN[4]=scale, IN[5]=sunScale, IN[6]=annualSunpath, IN[7]=daylightSavingPeriod)
code_block_2 = CodeBlock(out=python_script_from_string) { out[0]; out[1]; out[2]; out[3]; out[4]; out[5]; out[6]; out[7]; }
sunVectors = Output(code_block_2.out0)
sunAltitudes = Output(code_block_2.out1)
sunAzimuths = Output(code_block_2.out2)
sunSpheres = Output(code_block_2.out3)
geometry = Output(code_block_2.out4)
centerPt_2 = Output(code_block_2.out5)  # "centerPt"
sunPositions = Output(code_block_2.out6)
datetimes = Output(code_block_2.out7)
code_block_3 = CodeBlock { 225; }
byARGB = Color.ByARGB(r=code_block_3)
byGeometryColor = Display.Display.ByGeometryColor(code_block_2.out3, byARGB)
preview = Output(byGeometryColor)
