# Dynamo graph sunpath.dyn (Dynamo 0.9.1.3360)

file_path = Filename("C:\EnergyPlusV8-3-0\WeatherData\USA_VA_Sterling-Washington.Dulles.Intl.AP.724030_TMY3.epw")
import_location = Custom[Import Location](epwFile=file_path)  # Import location data from an epw weather file
code_block = CodeBlock { 6..20; }
boolean = BoolSelector(false)
sunpath = Custom[Sunpath](location=import_location, hoursOfYear=code_block, annualSunpath=boolean)  # Use this node to make a 3D sun-path (aka. sun plot) in the Dynamo scene. The node also outputs sun vectors that can be used for sunlight hours analysis or shading design with the other Ladybug nodes.
byStartPointEndPoint = Line.ByStartPointEndPoint(startPoint=sunpath.centerPt, endPoint=sunpath.sunPositions)
code_block_2 = CodeBlock { 225; }
byARGB = Color.ByARGB(r=code_block_2)
byGeometryColor = Display.Display.ByGeometryColor(sunpath.sunSpheres, byARGB)
change_the_scale = CodeBlock { 0.5; }
integer_slider = IntegerSlider(13, range=8..18 step 1)
create = List.Create(integer_slider)
watch = Watch(sunpath.sunVectors)
